# Grasshopper definition curvature_lines.gh (Grasshopper 0.9.14)
# plug-ins: Decodes Python Interpreter

md_slider = MDSlider(
    slider_value=Point(0.4765854347, 0.5359022094, 0.5),
    x_domain=Domain(0, 1),
    y_domain=Domain(0, 1),
    z_domain=Domain(0, 1),
    SliderMode=0)
_0_75_0_5 = Point(Point(0.5, 0.75, 0))
_0_5_0_5 = Point(Point(0.5, 0.5, 0))
decodes = DecodesPythonScript(uv=_0_75_0_5)  # -> console, a, b, c
# ---------- decodes: Python ----------
u,v = uv.x,uv.y
step = 0.1

def func(u,v):
    return Point(u,v,(u**3-3*u*v**2)/5)
    
ival = Interval(-1,1)
surf = Surface(func,ival,ival)
crv = surf.eval_curv(u,v,False)

a.put(surf.surrogate)
b.put(surf.eval_curv(u,v,True))

pt, u_vec, v_vec = surf._nudged(ival.eval(u),ival.eval(v),False)
u_vec = u_vec.normalized()
v_vec = v_vec.normalized()
crv_vec = crv.x_axis.normalized()
#crv_vec = crv.x_axis.inverted().normalized()
#crv_vec = crv.y_axis.inverted().normalized()

du = u_vec.projected_length(crv_vec)
dv = v_vec.projected_length(crv_vec)
d_vec = Vec(du,dv).normalized(step)

uv = uv+d_vec
u,v = uv.x,uv.y


c.put([pt,u_vec.to_ray(pt),v_vec.to_ray(pt),crv_vec.to_ray(pt)])
c.put(surf.eval(u,v))

#pln = surf.deval_pln(u,v)
# ---------- end decodes ----------
panel = Panel(decodes.b)
