# Grasshopper definition gh out test.gh (Grasshopper 0.9.14)
# plug-ins: Python Interpreter

python = PythonScript(x=Slider(7, range=0..10))  # -> out, a
# ---------- python: Python ----------
import decodes.core as dc
from decodes.core import *
a = dc.makeOut(outies.Grasshopper)


pt = Point(1,1,x)
vec = Vec(0,10,x)
seg = Line(Point(1,1,x),Vec(0,0,-2))
cs = CS(Point(-2,-x), Vec(0,2,x))

verts = [
  Point(0.0       , 0.0	      , 0.0),
  Point(0.9510565 , 0.0	      , 0.0),
  Point(0.6881910 , 1.3763819 , 0.0),
  Point(0.5257311 , 0.6881910	, x/2)
]
faces = [[0,1,2],[0,2,3],[2,3,0],[3,0,1]]
mesh = dc.Mesh(verts,faces)

a.put([pt,pt,pt])
a.put(pt)
#a.put(10)


print a.geom

a = a.extract_tree()
# ---------- end python ----------
geo = Geometry(python.a)
panel = Panel(python.a)
panel_2 = Panel(python.out)
